# Grasshopper definition carcara_winsetup_rev04.gh (Grasshopper 1.0.8)

# ----
# 01. INSTALL DRIVER ODBC
catches = BooleanToggle(False)
driver_odbc_installer = Python3Script(Install_driver=catches)  # -> out
# ---------- driver_odbc_installer: Python ----------
import os
import urllib.request
import subprocess

# Function to download the file
def download_file(url, output_path):
    try:
        # Download the file using urllib
        urllib.request.urlretrieve(url, output_path)
        return f"File downloaded successfully to {output_path}"
    except Exception as e:
        return f"Error downloading the file: {e}"

# Function to execute the file
def execute_file(file_path):
    try:
        subprocess.run([file_path], check=True)
        return f"File executed successfully: {file_path}"
    except subprocess.CalledProcessError as e:
        return f"Error executing the file: {e}"

# Function to check if the driver is installed (simple example)
def check_driver_installed():
    # Simple example, you might want to perform a more specific check
    # like searching the registry in Windows or checking if the file exists
    # in a specific directory.
    driver_installed = os.path.exists("C:\\Program Files\\psqlodbc\\psqlodbc.dll")  # Example
    return driver_installed

# Get the Downloads folder path dynamically
if os.name == 'nt':  # For Windows
    download_path = os.path.join(os.environ['USERPROFILE'], 'Downloads')
elif os.name == 'posix':  # For macOS or Linux
    download_path = os.path.join(os.environ['HOME'], 'Downloads')
else:
    raise Exception("Unsupported operating system")

# URL of the file you want to download
url = "https://ftp.postgresql.org/pub/odbc/releases/REL-17_00_0003-mimalloc/psqlodbc-setup.exe"
# Complete path where the file will be saved
output_path = os.path.join(download_path, "psqlodbc-setup.exe")

# Set the install value directly (True or False)

# Variable to store the output
out = ""

# Check if the installation should proceed
if Install_driver:
    # Download the file
    out = download_file(url, output_path)
    
    # If the file was downloaded successfully, try to execute it
    if "success" in out:
        out = execute_file(output_path)
        
        # After executing, check if the driver was installed
        if check_driver_installed():
            out = "Driver installed successfully!"
        else:
            out = "Failed to install the driver."

else:
    out = "Installation not activated."

# Print the final result
print(out)

ghenv.Component.Message = "v1.0.0"
# ---------- end driver_odbc_installer ----------
panel = Panel(driver_odbc_installer)

# ----
# general info
# The Carcará plugin is a set of user objects built using the power of the python 3 component. Access to databases is via the ODCB driver, which needs to be installed on the operating system (01).
# 
# The components are downloaded from the github repository (https://github.com/led-ufc/carcara) where their latest version is hosted. If you already have a previous installation, the procedure will ask you if you want to replace the existing files (02).
# 
# Finally, some libraries for python 3 are required, and these are automatically installed in rhino's python 3 environment (03.)
c_script = CSharpScript()  # -> filename
# ---------- c_script: C# ----------
// Grasshopper Script Instance
#region Usings
using System;
using System.Linq;
using System.Collections;
using System.Collections.Generic;
using System.Drawing;

using Rhino;
using Rhino.Geometry;

using Grasshopper;
using Grasshopper.Kernel;
using Grasshopper.Kernel.Data;
using Grasshopper.Kernel.Types;
#endregion

public class Script_Instance : GH_ScriptInstance
{
    #region Notes
    /* 
      Members:
        RhinoDoc RhinoDocument
        GH_Document GrasshopperDocument
        IGH_Component Component
        int Iteration

      Methods (Virtual & overridable):
        Print(string text)
        Print(string format, params object[] args)
        Reflect(object obj)
        Reflect(object obj, string method_name)
    */
    #endregion

    private void RunScript(ref object filename)
    {
        var filename_only = System.IO.Path.GetFileName(GrasshopperDocument.FilePath);
    filename = filename_only;
    }
}
# ---------- end c_script ----------
panel_2 = Panel(c_script)

# ----
# 02. INSTALL CARCARÁ
kills = BooleanToggle(False)
install_carcará_clusters = Python3Script(install=kills)  # -> out
# ---------- install_carcará_clusters: Python ----------
import os
import shutil
import zipfile
import urllib.request
import System.Windows.Forms as WF

# Declare a persistent module-level variable to track the previous state.
# This variable will persist as long as the component's script is not recompiled.
try:
    prev_install
except NameError:
    prev_install = False

def download_file(url, output_path):
    try:
        urllib.request.urlretrieve(url, output_path)
        return "File downloaded successfully"
    except Exception as e:
        return f"Error downloading file: {e}"

def extract_zip(zip_path, extraction_folder):
    try:
        os.makedirs(extraction_folder, exist_ok=True)
        with zipfile.ZipFile(zip_path, 'r') as zip_ref:
            zip_ref.extractall(extraction_folder)
        return "File extracted successfully"
    except Exception as e:
        return f"Error extracting file: {e}"

def replace_folder(source_folder, target_folder):
    try:
        if os.path.exists(target_folder):
            shutil.rmtree(target_folder)
        shutil.move(source_folder, target_folder)
        return "Folder replaced successfully"
    except Exception as e:
        return f"Error replacing folder: {e}"

def install_carcara():
    out = ""
    
    # URL to download the repository's master branch as a zip file.
    github_zip_url = "https://github.com/led-ufc/carcara/archive/refs/heads/master.zip"
    
    # Define paths for download and temporary extraction.
    downloads_folder = os.path.join(os.path.expanduser("~"), "Downloads")
    zip_filename = "carcara_master.zip"
    zip_path = os.path.join(downloads_folder, zip_filename)
    temp_extract_folder = os.path.join(downloads_folder, "temp_carcara_extract")
    
    # Grasshopper UserObjects folder (typically under APPDATA on Windows)
    user_objects_folder = os.path.join(os.environ.get("APPDATA", ""), "Grasshopper", "UserObjects")
    target_folder = os.path.join(user_objects_folder, "carcara")
    
    # Step 1: Download the GitHub zip
    result = download_file(github_zip_url, zip_path)
    if "successfully" not in result:
        return result
    print(result)
    
    # Step 2: Extract the zip file
    result = extract_zip(zip_path, temp_extract_folder)
    if "successfully" not in result:
        return result
    print(result)
    
    # Step 3: Locate the 'carcara' folder within the extracted repository.
    # Expected structure: "carcara-master/carcara"
    extracted_repo_folder = os.path.join(temp_extract_folder, "carcara-master")
    source_folder = os.path.join(extracted_repo_folder, "carcara")
    if not os.path.exists(source_folder):
        return "The folder 'carcara' was not found in the extracted repository."
    
    # Step 4: If target folder exists, prompt the user for confirmation.
    if os.path.exists(target_folder):
        response = WF.MessageBox.Show("Folder 'carcara' already exists. Do you want to replace it?", 
                                      "Confirm Replacement", WF.MessageBoxButtons.YesNo)
        if response != WF.DialogResult.Yes:
            return "Installation cancelled by user."
    
    # Step 5: Replace the folder
    result = replace_folder(source_folder, target_folder)
    print(result)
    out = result
    
    # Step 6: Cleanup temporary files
    try:
        if os.path.exists(zip_path):
            os.remove(zip_path)
        if os.path.exists(temp_extract_folder):
            shutil.rmtree(temp_extract_folder)
        print("Cleanup completed.")
    except Exception as e:
        out += f" However, cleanup failed: {e}"
    
    return out

# Use the module-level variable 'prev_install' to detect a rising edge.
# This ensures the installation only runs when 'install' transitions from False to True.
if install and not prev_install:
    out = install_carcara()
else:
    out = "Installation not activated."

# Update the persistent state with the current install value.
prev_install = install

print(out)


ghenv.Component.Message = "v1.0.1"
# ---------- end install_carcará_clusters ----------
panel_3 = Panel(install_carcará_clusters)

# ----
# 03. INSTALL PYTHON LIBRARIES
and_eats = BooleanToggle(False)
install_python_libraries = Python3Script(install=and_eats)  # -> out
# ---------- install_python_libraries: Python ----------
import os
import subprocess
import getpass

def install_libraries(libraries, pip_executable):
    for library in libraries:
        print(f"Installing {library}...")
        result = subprocess.run([pip_executable, "install", library], capture_output=True, text=True)
        print(f"Result for {library}:")
        print(result.stdout)
        if result.returncode != 0:
            print(f"Error installing {library}:")
            print(result.stderr)

# Get the current user
user = getpass.getuser()

# Define the path to the pip executable
pip_executable = f"C:\\Users\\{user}\\.rhinocode\\py39-rh8\\Scripts\\pip.exe"

# List of libraries to install
libraries_to_install = ['pyodbc', 'shapely', 'matplotlib', 'numpy']

# Flag to control installation
install_libraries_flag = True

if install:
    install_libraries(libraries_to_install, pip_executable)
else:
    print('Installation not activated.')


ghenv.Component.Message = "v1.0.1"
# ---------- end install_python_libraries ----------
panel_4 = Panel(install_python_libraries)
