# Grasshopper definition carcara_winsetup_rev06.gh (Grasshopper 1.0.8)

# ----
# 01. INSTALL DRIVER ODBC
catches = BooleanToggle(False)
driver_odbc_installer = Python3Script(Install_driver=catches)  # -> out
# ---------- driver_odbc_installer: Python ----------
"""PostgreSQL ODBC Driver Installer - Grasshopper Component

This component automates the download and installation of the PostgreSQL ODBC driver.
Includes version checking to avoid unnecessary reinstallation and provides detailed
feedback throughout the process.


Args (Component Inputs):
    Install_driver (bool): Enable installation process
        - Type: bool
        - Access: item
        - Optional: No
        - Note: Component will not proceed if False

Returns (Component Outputs):
    out (str): Status message with installation progress/results
    current_version (str): Currently installed driver version (if any)

Version: 1.1.0
Date: 2025/10/16
Requires: urllib, subprocess, winreg (Windows only)
"""

import os
import sys
import urllib.request
import subprocess
import hashlib
from Grasshopper.Kernel import GH_RuntimeMessageLevel as RML

# Windows-specific imports
if os.name == 'nt':
    try:
        import winreg
    except ImportError:
        import _winreg as winreg  # Python 2 fallback


###############################################################################
# CONFIGURATION
###############################################################################

DRIVER_URL = "https://ftp.postgresql.org/pub/odbc/releases/REL-17_00_0003-mimalloc/psqlodbc-setup.exe"
DRIVER_FILENAME = "psqlodbc-setup.exe"
TARGET_VERSION = "17.00.0003"  # Version we're installing

# Expected installation paths (Windows)
DRIVER_PATHS = [
    r"C:\Program Files\psqlodbc\psqlodbc.dll",
    r"C:\Program Files (x86)\psqlodbc\psqlodbc.dll"
]

# Registry keys for version checking (Windows)
REGISTRY_KEYS = [
    (winreg.HKEY_LOCAL_MACHINE, r"SOFTWARE\PostgreSQL\ODBC"),
    (winreg.HKEY_LOCAL_MACHINE, r"SOFTWARE\WOW6432Node\PostgreSQL\ODBC"),
    (winreg.HKEY_CURRENT_USER, r"SOFTWARE\PostgreSQL\ODBC")
]


###############################################################################
# HELPER FUNCTIONS
###############################################################################

def report(level, message):
    """
    Send runtime message to Grasshopper component.
    
    Args:
        level: Message severity level
        message (str): Message text
    """
    ghenv.Component.AddRuntimeMessage(level, message)
    print(message)


def parse_version(version_str):
    """
    Parse version string to tuple for comparison.
    
    Args:
        version_str (str): Version string (e.g., "17.00.0003")
    
    Returns:
        tuple: Version as tuple of integers, or None if invalid
    """
    try:
        parts = version_str.replace('.', ' ').replace('-', ' ').split()
        return tuple(int(p) for p in parts if p.isdigit())
    except:
        return None


def compare_versions(version1, version2):
    """
    Compare two version strings.
    
    Args:
        version1 (str): First version
        version2 (str): Second version
    
    Returns:
        int: -1 if v1 < v2, 0 if v1 == v2, 1 if v1 > v2, None if comparison fails
    """
    v1 = parse_version(version1)
    v2 = parse_version(version2)
    
    if v1 is None or v2 is None:
        return None
    
    if v1 < v2:
        return -1
    elif v1 > v2:
        return 1
    else:
        return 0


def get_driver_version_from_registry():
    """
    Get PostgreSQL ODBC driver version from Windows registry.
    
    Returns:
        str: Version string or None if not found
    """
    if os.name != 'nt':
        return None
    
    for hkey, subkey in REGISTRY_KEYS:
        try:
            key = winreg.OpenKey(hkey, subkey, 0, winreg.KEY_READ)
            try:
                version, _ = winreg.QueryValueEx(key, "Version")
                winreg.CloseKey(key)
                report(RML.Remark, "Found driver version in registry: {}".format(version))
                return version
            except WindowsError:
                winreg.CloseKey(key)
                continue
        except WindowsError:
            continue
    
    return None


def get_driver_version_from_file():
    """
    Get driver version from file properties (Windows).
    
    Returns:
        str: Version string or None if not found
    """
    if os.name != 'nt':
        return None
    
    for dll_path in DRIVER_PATHS:
        if os.path.exists(dll_path):
            try:
                # Try to get file version using win32api if available
                try:
                    import win32api
                    info = win32api.GetFileVersionInfo(dll_path, "\\")
                    ms = info['FileVersionMS']
                    ls = info['FileVersionLS']
                    version = "{}.{}.{}.{}".format(
                        win32api.HIWORD(ms),
                        win32api.LOWORD(ms),
                        win32api.HIWORD(ls),
                        win32api.LOWORD(ls)
                    )
                    report(RML.Remark, "Found driver version from file: {}".format(version))
                    return version
                except ImportError:
                    # win32api not available, skip
                    pass
            except Exception as e:
                report(RML.Warning, "Could not read version from {}: {}".format(dll_path, e))
    
    return None


def get_installed_driver_version():
    """
    Get currently installed PostgreSQL ODBC driver version.
    
    Tries multiple methods to detect version.
    
    Returns:
        str: Version string or "Unknown" if installed but version unknown, or None if not installed
    """
    # Method 1: Check registry
    version = get_driver_version_from_registry()
    if version:
        return version
    
    # Method 2: Check file properties
    version = get_driver_version_from_file()
    if version:
        return version
    
    # Method 3: Check if driver exists (version unknown)
    is_installed, driver_path = check_driver_installed()
    if is_installed:
        report(RML.Warning, "Driver found but version could not be determined")
        return "Unknown"
    
    return None


def check_if_update_needed(current_version, target_version):
    """
    Check if driver update is needed.
    
    Args:
        current_version (str): Currently installed version
        target_version (str): Target version to install
    
    Returns:
        tuple: (needs_update: bool, reason: str)
    """
    if current_version is None:
        return True, "Driver not installed"
    
    if current_version == "Unknown":
        return True, "Version unknown, reinstall recommended"
    
    comparison = compare_versions(current_version, target_version)
    
    if comparison is None:
        return True, "Unable to compare versions"
    elif comparison < 0:
        return True, "Newer version available ({} -> {})".format(current_version, target_version)
    elif comparison == 0:
        return False, "Current version ({}) is up to date".format(current_version)
    else:
        return False, "Installed version ({}) is newer than target ({})".format(current_version, target_version)


def get_downloads_folder():
    """
    Get user's Downloads folder path cross-platform.
    
    Returns:
        str: Path to Downloads folder
    
    Raises:
        OSError: If operating system is unsupported
    """
    if os.name == 'nt':  # Windows
        return os.path.join(os.environ['USERPROFILE'], 'Downloads')
    elif os.name == 'posix':  # macOS/Linux
        return os.path.join(os.environ['HOME'], 'Downloads')
    else:
        raise OSError("Unsupported operating system: {}".format(os.name))


def download_file(url, output_path):
    """
    Download file from URL with error handling.
    
    Args:
        url (str): Download URL
        output_path (str): Destination file path
    
    Returns:
        tuple: (success: bool, message: str)
    """
    try:
        report(RML.Remark, "Downloading from: {}".format(url))
        urllib.request.urlretrieve(url, output_path)
        
        file_size = os.path.getsize(output_path)
        report(
            RML.Remark,
            "Downloaded successfully: {} ({:.2f} MB)".format(
                output_path,
                file_size / (1024 * 1024)
            )
        )
        return True, "Download successful"
    
    except urllib.error.URLError as e:
        error_msg = "Network error: {}".format(e.reason)
        report(RML.Error, error_msg)
        return False, error_msg
    except Exception as e:
        error_msg = "Download error: {}".format(e)
        report(RML.Error, error_msg)
        return False, error_msg


def execute_installer(file_path):
    """
    Execute installer with user privileges.
    
    Args:
        file_path (str): Path to installer executable
    
    Returns:
        tuple: (success: bool, message: str)
    """
    try:
        if not os.path.exists(file_path):
            return False, "Installer file not found: {}".format(file_path)
        
        report(RML.Warning, "Launching installer. Please follow on-screen instructions.")
        
        process = subprocess.Popen([file_path])
        process.wait()
        
        if process.returncode == 0:
            return True, "Installer completed successfully"
        else:
            return False, "Installer returned error code: {}".format(process.returncode)
    
    except subprocess.CalledProcessError as e:
        error_msg = "Installer execution failed: {}".format(e)
        report(RML.Error, error_msg)
        return False, error_msg
    except Exception as e:
        error_msg = "Unexpected error: {}".format(e)
        report(RML.Error, error_msg)
        return False, error_msg


def check_driver_installed():
    """
    Verify PostgreSQL ODBC driver installation.
    
    Checks multiple common installation paths.
    
    Returns:
        tuple: (installed: bool, path: str or None)
    """
    for path in DRIVER_PATHS:
        if os.path.exists(path):
            return True, path
    
    return False, None


def cleanup_installer(file_path):
    """
    Remove downloaded installer file.
    
    Args:
        file_path (str): Path to installer file
    
    Returns:
        bool: True if removed successfully
    """
    try:
        if os.path.exists(file_path):
            os.remove(file_path)
            report(RML.Remark, "Installer file removed: {}".format(file_path))
            return True
    except Exception as e:
        report(RML.Warning, "Could not remove installer: {}".format(e))
    return False


###############################################################################
# INPUT HANDLING
###############################################################################

Install_driver = globals().get('Install_driver', False)

if not isinstance(Install_driver, bool):
    Install_driver = False


###############################################################################
# MAIN EXECUTION
###############################################################################

out = ""
current_version = None

try:
    if not Install_driver:
        out = "Installation not activated. Set 'Install_driver' to True to proceed."
        report(RML.Remark, out)
    else:
        # Step 1: Check current version
        report(RML.Remark, "Checking for installed PostgreSQL ODBC driver...")
        current_version = get_installed_driver_version()
        
        if current_version:
            report(RML.Remark, "Current version: {}".format(current_version))
        else:
            report(RML.Remark, "Driver not currently installed")
        
        # Step 2: Determine if installation needed
        needs_install, reason = check_if_update_needed(current_version, TARGET_VERSION)
        report(RML.Remark, reason)
        
        if not needs_install:
            out = "No installation needed. {}".format(reason)
            report(RML.Remark, out)
        else:
            # Step 3: Get download path
            downloads_folder = get_downloads_folder()
            installer_path = os.path.join(downloads_folder, DRIVER_FILENAME)
            
            # Step 4: Download installer
            success, message = download_file(DRIVER_URL, installer_path)
            
            if not success:
                out = "Download failed: {}".format(message)
            else:
                # Step 5: Execute installer
                report(
                    RML.Warning,
                    "⚠️ About to install version {}. This will open installation wizard.".format(TARGET_VERSION)
                )
                
                success, message = execute_installer(installer_path)
                
                if not success:
                    out = "Installation failed: {}".format(message)
                else:
                    # Step 6: Verify installation
                    new_version = get_installed_driver_version()
                    
                    if new_version:
                        if current_version:
                            out = "✓ Driver updated: {} -> {}".format(current_version, new_version)
                        else:
                            out = "✓ Driver installed successfully: version {}".format(new_version)
                        report(RML.Remark, out)
                        current_version = new_version
                    else:
                        out = "Installation completed but driver not detected. Manual verification needed."
                        report(RML.Warning, out)
                    
                    # Step 7: Cleanup
                    cleanup_installer(installer_path)

except OSError as e:
    out = "System error: {}".format(e)
    report(RML.Error, out)
except Exception as e:
    out = "Unexpected error: {}".format(e)
    report(RML.Error, out)


###############################################################################
# OUTPUT
###############################################################################

ghenv.Component.Message = "v1.1.0"
# ---------- end driver_odbc_installer ----------
panel = Panel(driver_odbc_installer)

# ----
# 02. INSTALL CARCARÁ
kills = BooleanToggle(False)
install_carcará_clusters = Python3Script(install=kills)  # -> out
# ---------- install_carcará_clusters: Python ----------
"""Carcara Library Installer - Grasshopper Component

This component automates the download and installation of the Carcara library
from GitHub. Includes backup, version checking, and user confirmation for
reinstallation when already up-to-date.

⚠️ Important: This component modifies Grasshopper UserObjects folder.
A backup is automatically created before any changes.

Args (Component Inputs):
    install (bool): Trigger installation/update
        - Type: bool
        - Access: item
        - Optional: No
        - Note: Uses edge detection (only runs on False->True transition)

Returns (Component Outputs):
    out (str): Installation status and messages
    installed_version (str): Currently installed version
    available_version (str): Latest version from GitHub

Version: 1.2.0
Date: 2025/10/16
Requires: urllib, zipfile, shutil, System.Windows.Forms
"""

import os
import shutil
import zipfile
import urllib.request
from datetime import datetime
import System.Windows.Forms as WF
from Grasshopper.Kernel import GH_RuntimeMessageLevel as RML


###############################################################################
# CONFIGURATION
###############################################################################

GITHUB_REPO = "led-ufc/carcara"
GITHUB_ZIP_URL = "https://github.com/{}/archive/refs/heads/master.zip".format(GITHUB_REPO)
GITHUB_VERSION_URL = "https://raw.githubusercontent.com/{}/master/carcara/version.txt".format(GITHUB_REPO)

# Paths
USER_OBJECTS_FOLDER = os.path.join(os.environ.get("APPDATA", ""), "Grasshopper", "UserObjects")
TARGET_FOLDER = os.path.join(USER_OBJECTS_FOLDER, "carcara")
DOWNLOADS_FOLDER = os.path.join(os.path.expanduser("~"), "Downloads")
VERSION_FILE = "version.txt"


###############################################################################
# PERSISTENT STATE (Edge Detection)
###############################################################################

try:
    prev_install
except NameError:
    prev_install = False


###############################################################################
# HELPER FUNCTIONS
###############################################################################

def report(level, message):
    """Send runtime message to Grasshopper component."""
    ghenv.Component.AddRuntimeMessage(level, message)
    print(message)


def get_installed_version():
    """Get currently installed Carcara version."""
    version_path = os.path.join(TARGET_FOLDER, VERSION_FILE)
    if os.path.exists(version_path):
        try:
            with open(version_path, 'r') as f:
                version = f.read().strip()
                return version
        except Exception as e:
            report(RML.Warning, "Could not read version file: {}".format(e))
    return None


def get_available_version():
    """Get latest Carcara version from GitHub."""
    try:
        response = urllib.request.urlopen(GITHUB_VERSION_URL, timeout=10)
        version = response.read().decode('utf-8').strip()
        return version
    except urllib.error.HTTPError as e:
        if e.code == 404:
            report(RML.Remark, "version.txt not found in repository")
            return "Unknown"
        else:
            report(RML.Warning, "HTTP error fetching version: {}".format(e))
            return None
    except Exception as e:
        report(RML.Warning, "Could not fetch remote version: {}".format(e))
        return None


def compare_versions(current, available):
    """Compare version strings."""
    if current is None:
        return -1  # Not installed
    if available is None or available == "Unknown":
        return None  # Can't determine
    
    try:
        if current < available:
            return -1  # Update available
        elif current > available:
            return 1   # Current is newer
        else:
            return 0   # Same version
    except:
        return None


def ask_user_confirmation(message, title="Confirm Installation"):
    """
    Show confirmation dialog to user.
    
    Args:
        message (str): Dialog message
        title (str): Dialog title
    
    Returns:
        bool: True if user clicked Yes
    """
    response = WF.MessageBox.Show(
        message,
        title,
        WF.MessageBoxButtons.YesNo,
        WF.MessageBoxIcon.Question
    )
    return response == WF.DialogResult.Yes


def check_if_should_proceed(installed_version, available_version):
    """
    Determine if installation should proceed based on versions.
    
    Shows appropriate dialogs for different scenarios.
    
    Returns:
        tuple: (should_proceed: bool, reason: str)
    """
    comparison = compare_versions(installed_version, available_version)
    
    # Scenario 1: Not installed
    if installed_version is None:
        return True, "Installing Carcara for the first time"
    
    # Scenario 2: Can't check version
    if comparison is None:
        message = (
            "Cannot verify remote version.\n\n"
            "Current version: {}\n\n"
            "Proceed with installation anyway?"
        ).format(installed_version)
        
        if ask_user_confirmation(message, "Version Check Failed"):
            return True, "User chose to proceed despite version check failure"
        else:
            return False, "User cancelled installation"
    
    # Scenario 3: Update available
    if comparison == -1:
        message = (
            "An update is available!\n\n"
            "Installed version: {}\n"
            "Available version: {}\n\n"
            "Update now?"
        ).format(installed_version, available_version)
        
        if ask_user_confirmation(message, "Update Available"):
            return True, "Updating from {} to {}".format(installed_version, available_version)
        else:
            return False, "User cancelled update"
    
    # Scenario 4: Already up-to-date
    elif comparison == 0:
        message = (
            "Carcara {} is already up to date.\n\n"
            "Do you want to reinstall anyway?\n\n"
            "(This can help repair corrupted installations)"
        ).format(installed_version)
        
        if ask_user_confirmation(message, "Already Up-to-Date"):
            return True, "Reinstalling version {} (user confirmed)".format(installed_version)
        else:
            return False, "Installation skipped - already up to date"
    
    # Scenario 5: Local version is newer
    elif comparison == 1:
        message = (
            "Your installed version is NEWER than available!\n\n"
            "Installed version: {}\n"
            "Available version: {}\n\n"
            "Do you want to DOWNGRADE?"
        ).format(installed_version, available_version)
        
        if ask_user_confirmation(message, "Downgrade Warning"):
            return True, "Downgrading from {} to {} (user confirmed)".format(installed_version, available_version)
        else:
            return False, "User cancelled downgrade"
    
    return False, "Unknown version comparison result"


def download_file(url, output_path):
    """Download file with progress indication."""
    try:
        report(RML.Remark, "Downloading from: {}".format(url))
        urllib.request.urlretrieve(url, output_path)
        
        file_size = os.path.getsize(output_path)
        return True, "Downloaded successfully ({:.2f} MB)".format(file_size / (1024 * 1024))
    except Exception as e:
        return False, "Download error: {}".format(e)


def extract_zip(zip_path, extraction_folder):
    """Extract ZIP file."""
    try:
        os.makedirs(extraction_folder, exist_ok=True)
        with zipfile.ZipFile(zip_path, 'r') as zip_ref:
            zip_ref.extractall(extraction_folder)
        return True, "Extracted successfully"
    except Exception as e:
        return False, "Extraction error: {}".format(e)


def backup_folder_as_zip(target_folder):
    """Create timestamped ZIP backup of folder."""
    try:
        parent = os.path.dirname(target_folder)
        folder_name = os.path.basename(target_folder.rstrip("\\/"))
        timestamp = datetime.now().strftime("%Y%m%d-%H%M%S")
        base_name = os.path.join(parent, "{}-{}".format(folder_name, timestamp))
        
        archive_path = shutil.make_archive(
            base_name=base_name,
            format='zip',
            root_dir=parent,
            base_dir=folder_name
        )
        return True, archive_path, "Backup created: {}".format(archive_path)
    except Exception as e:
        return False, None, "Backup error: {}".format(e)


def rollback_from_backup(backup_path, target_folder):
    """Restore folder from backup ZIP."""
    try:
        if os.path.exists(target_folder):
            shutil.rmtree(target_folder)
        
        parent = os.path.dirname(target_folder)
        with zipfile.ZipFile(backup_path, 'r') as zip_ref:
            zip_ref.extractall(parent)
        
        report(RML.Warning, "Rollback successful from: {}".format(backup_path))
        return True
    except Exception as e:
        report(RML.Error, "Rollback failed: {}".format(e))
        return False


def replace_folder(source_folder, target_folder, backup_path=None):
    """Replace target folder with source, with rollback on failure."""
    try:
        if os.path.exists(target_folder):
            shutil.rmtree(target_folder)
        
        shutil.move(source_folder, target_folder)
        return True, "Installation successful"
    except Exception as e:
        error_msg = "Installation error: {}".format(e)
        
        if backup_path and os.path.exists(backup_path):
            report(RML.Warning, "Attempting rollback...")
            if rollback_from_backup(backup_path, target_folder):
                error_msg += " (Rollback successful)"
            else:
                error_msg += " (Rollback FAILED - manual intervention needed!)"
        
        return False, error_msg


def cleanup_files(*paths):
    """Remove temporary files and folders."""
    for path in paths:
        try:
            if os.path.exists(path):
                if os.path.isfile(path):
                    os.remove(path)
                else:
                    shutil.rmtree(path)
        except Exception as e:
            report(RML.Warning, "Cleanup warning for {}: {}".format(path, e))


def install_carcara():
    """Main installation function."""
    zip_filename = "carcara_master.zip"
    zip_path = os.path.join(DOWNLOADS_FOLDER, zip_filename)
    temp_extract_folder = os.path.join(DOWNLOADS_FOLDER, "temp_carcara_extract")
    backup_path = None
    
    try:
        # Step 1: Download
        success, message = download_file(GITHUB_ZIP_URL, zip_path)
        if not success:
            return message
        report(RML.Remark, message)
        
        # Step 2: Extract
        success, message = extract_zip(zip_path, temp_extract_folder)
        if not success:
            cleanup_files(zip_path)
            return message
        report(RML.Remark, message)
        
        # Step 3: Locate carcara folder
        extracted_repo_folder = os.path.join(temp_extract_folder, "carcara-master")
        source_folder = os.path.join(extracted_repo_folder, "carcara")
        
        if not os.path.exists(source_folder):
            cleanup_files(zip_path, temp_extract_folder)
            return "Error: 'carcara' folder not found in repository"
        
        # Step 4: Backup if folder exists
        if os.path.exists(TARGET_FOLDER):
            success, backup_path, message = backup_folder_as_zip(TARGET_FOLDER)
            if not success:
                cleanup_files(zip_path, temp_extract_folder)
                return message
            report(RML.Remark, message)
        
        # Step 5: Replace folder
        success, message = replace_folder(source_folder, TARGET_FOLDER, backup_path)
        if not success:
            cleanup_files(zip_path, temp_extract_folder)
            return message
        
        # Step 6: Cleanup
        cleanup_files(zip_path, temp_extract_folder)
        
        # Step 7: Verify new version
        new_version = get_installed_version()
        if new_version:
            return "✓ Carcara {} installed successfully".format(new_version)
        else:
            return "✓ Carcara installed successfully"
    
    except Exception as e:
        return "Unexpected error: {}".format(e)


###############################################################################
# MAIN EXECUTION
###############################################################################

out = ""
installed_version = get_installed_version()
available_version = get_available_version()

# Edge detection: only run on False->True transition
if install and not prev_install:
    # Check if installation should proceed (with user dialogs)
    should_proceed, reason = check_if_should_proceed(installed_version, available_version)
    
    report(RML.Remark, reason)
    
    if should_proceed:
        out = install_carcara()
        installed_version = get_installed_version()
    else:
        out = reason
else:
    if installed_version:
        if available_version and available_version != "Unknown":
            comparison = compare_versions(installed_version, available_version)
            if comparison == 0:
                out = "Carcara {} is up to date. Set 'install' to True to reinstall.".format(installed_version)
            elif comparison == -1:
                out = "Carcara {} installed. Update to {} available! Set 'install' to True.".format(
                    installed_version, available_version
                )
            else:
                out = "Carcara {} is installed. Set 'install' to True to reinstall.".format(installed_version)
        else:
            out = "Carcara {} is installed. Set 'install' to True to reinstall.".format(installed_version)
    else:
        out = "Carcara is not installed. Set 'install' to True to install."

# Update persistent state
prev_install = install


###############################################################################
# OUTPUT
###############################################################################

ghenv.Component.Message = "v1.2.0"
# ---------- end install_carcará_clusters ----------
panel_2 = Panel(install_carcará_clusters)

# ----
# general info
# The Carcará plugin is a set of user objects built using the power of the python 3 component. Access to databases is via the ODCB driver, which needs to be installed on the operating system (01).
# 
# The components are downloaded from the github repository (https://github.com/led-ufc/carcara) where their latest version is hosted. If you already have a previous installation, the procedure will ask you if you want to replace the existing files (02).
# 
# Finally, some libraries for python 3 are required, and these are automatically installed in rhino's python 3 environment (03.)
c_script = CSharpScript()  # -> filename
# ---------- c_script: C# ----------
// Grasshopper Script Instance
#region Usings
using System;
using System.Linq;
using System.Collections;
using System.Collections.Generic;
using System.Drawing;

using Rhino;
using Rhino.Geometry;

using Grasshopper;
using Grasshopper.Kernel;
using Grasshopper.Kernel.Data;
using Grasshopper.Kernel.Types;
#endregion

public class Script_Instance : GH_ScriptInstance
{
    #region Notes
    /* 
      Members:
        RhinoDoc RhinoDocument
        GH_Document GrasshopperDocument
        IGH_Component Component
        int Iteration

      Methods (Virtual & overridable):
        Print(string text)
        Print(string format, params object[] args)
        Reflect(object obj)
        Reflect(object obj, string method_name)
    */
    #endregion

    private void RunScript(ref object filename)
    {
        var filename_only = System.IO.Path.GetFileName(GrasshopperDocument.FilePath);
    filename = filename_only;
    }
}
# ---------- end c_script ----------
panel_3 = Panel(c_script)

# ----
# 03. INSTALL PYTHON LIBRARIES
and_eats = BooleanToggle(False)
install_python_libraries = Python3Script(install=and_eats)  # -> out
# ---------- install_python_libraries: Python ----------
"""Python Library Installer - Grasshopper Component

This component installs Python libraries into Rhino's Python environment.
Automatically detects the correct Python environment being used by Rhino/Grasshopper.

⚠️ Important: This modifies Rhino's Python environment.
Requires internet connection and may take several minutes.

Args (Component Inputs):
    install (bool): Trigger library installation
        - Type: bool
        - Access: item
        - Optional: No

Returns (Component Outputs):
    out (str): Installation status and messages
    installed_libs (list): List of successfully installed libraries
    python_version (str): Detected Python version

Version: 1.2.0
Date: 2025/10/16
Requires: subprocess, getpass, sys
"""

import os
import sys
import subprocess
import getpass
from Grasshopper.Kernel import GH_RuntimeMessageLevel as RML


###############################################################################
# CONFIGURATION
###############################################################################

# Libraries to install
LIBRARIES = [
    'pyodbc',
    'shapely',
    'matplotlib',
    'numpy'
]


###############################################################################
# PERSISTENT STATE (Edge Detection)
###############################################################################

try:
    prev_install
except NameError:
    prev_install = False


###############################################################################
# PYTHON ENVIRONMENT DETECTION
###############################################################################

def get_python_info():
    """
    Get information about the currently running Python environment.
    
    Returns:
        dict: Python environment information
    """
    info = {
        'version': sys.version,
        'version_info': sys.version_info,
        'executable': sys.executable,
        'prefix': sys.prefix,
        'is_ironpython': 'IronPython' in sys.version,
        'is_cpython': 'CPython' in sys.version or not 'IronPython' in sys.version
    }
    return info


def detect_rhino_python_env():
    """
    Detect which Rhino Python environment is being used.
    
    Returns:
        str: Environment identifier (e.g., "py39-rh8") or None
    """
    python_info = get_python_info()
    
    # Check if running IronPython (Rhino 5/6/7 or Rhino 8 GhPython component)
    if python_info['is_ironpython']:
        report(
            RML.Warning,
            "Running IronPython {}. Cannot install CPython packages.".format(
                python_info['version_info'][:2]
            )
        )
        return None
    
    # Extract environment from executable path
    # Example: C:\Users\...\\.rhinocode\py39-rh8\python.exe
    executable = python_info['executable']
    
    if '.rhinocode' in executable:
        # Extract environment name from path
        parts = executable.split(os.sep)
        for i, part in enumerate(parts):
            if part == '.rhinocode' and i + 1 < len(parts):
                env_name = parts[i + 1]
                return env_name
    
    return None


def get_pip_path_from_executable(python_executable):
    """
    Get pip path from Python executable path.
    
    Args:
        python_executable (str): Path to python.exe
    
    Returns:
        str: Path to pip.exe or None
    """
    # Get directory containing python.exe
    python_dir = os.path.dirname(python_executable)
    
    # pip.exe should be in Scripts subfolder
    pip_path = os.path.join(python_dir, "Scripts", "pip.exe")
    
    if os.path.exists(pip_path):
        return pip_path
    
    # Alternative: pip might be in same directory
    pip_path = os.path.join(python_dir, "pip.exe")
    if os.path.exists(pip_path):
        return pip_path
    
    return None


def get_pip_path():
    """
    Get path to pip executable in the current Python environment.
    
    Returns:
        str: Path to pip.exe or None if not found
    """
    python_info = get_python_info()
    
    # Method 1: Use current Python executable path
    pip_path = get_pip_path_from_executable(python_info['executable'])
    if pip_path:
        report(RML.Remark, "Found pip at: {}".format(pip_path))
        return pip_path
    
    # Method 2: Detect Rhino environment and construct path
    env_name = detect_rhino_python_env()
    if env_name:
        user = getpass.getuser()
        pip_path = os.path.join(
            "C:\\Users",
            user,
            ".rhinocode",
            env_name,
            "Scripts",
            "pip.exe"
        )
        
        if os.path.exists(pip_path):
            report(RML.Remark, "Found pip at: {}".format(pip_path))
            return pip_path
    
    # Method 3: Search common locations
    user = getpass.getuser()
    common_envs = ['py39-rh8', 'py310-rh8', 'py38-rh8', 'py311-rh8']
    
    for env in common_envs:
        pip_path = os.path.join(
            "C:\\Users",
            user,
            ".rhinocode",
            env,
            "Scripts",
            "pip.exe"
        )
        if os.path.exists(pip_path):
            report(
                RML.Warning,
                "Using fallback environment: {}".format(env)
            )
            return pip_path
    
    report(RML.Error, "pip.exe not found in any known location")
    return None


###############################################################################
# HELPER FUNCTIONS
###############################################################################

def report(level, message):
    """Send runtime message to Grasshopper component."""
    ghenv.Component.AddRuntimeMessage(level, message)
    print(message)


def check_library_installed(library_name, pip_path):
    """
    Check if library is already installed.
    
    Returns:
        tuple: (installed: bool, version: str or None)
    """
    try:
        result = subprocess.run(
            [pip_path, "show", library_name],
            capture_output=True,
            text=True,
            timeout=10
        )
        
        if result.returncode == 0:
            for line in result.stdout.split('\n'):
                if line.startswith('Version:'):
                    version = line.split(':', 1)[1].strip()
                    return True, version
            return True, "Unknown"
        else:
            return False, None
    except Exception as e:
        report(RML.Warning, "Error checking {}: {}".format(library_name, e))
        return False, None


def install_library(library_name, pip_path):
    """
    Install a single library using pip.
    
    Returns:
        tuple: (success: bool, message: str)
    """
    try:
        report(RML.Remark, "Installing {}...".format(library_name))
        
        result = subprocess.run(
            [pip_path, "install", library_name],
            capture_output=True,
            text=True,
            timeout=300
        )
        
        if result.returncode == 0:
            return True, "Successfully installed {}".format(library_name)
        else:
            error_msg = "Failed to install {}: {}".format(
                library_name,
                result.stderr.strip()
            )
            return False, error_msg
    
    except subprocess.TimeoutExpired:
        return False, "Installation of {} timed out".format(library_name)
    except Exception as e:
        return False, "Error installing {}: {}".format(library_name, e)


def install_all_libraries(libraries, pip_path):
    """
    Install all libraries with progress reporting.
    
    Returns:
        tuple: (results: dict, summary: str)
    """
    results = {
        'total': len(libraries),
        'installed': [],
        'already_installed': [],
        'failed': []
    }
    
    for lib in libraries:
        is_installed, version = check_library_installed(lib, pip_path)
        
        if is_installed:
            report(
                RML.Remark,
                "{} is already installed (version: {})".format(lib, version or "unknown")
            )
            results['already_installed'].append((lib, version))
        else:
            success, message = install_library(lib, pip_path)
            report(RML.Remark, message)
            
            if success:
                results['installed'].append(lib)
            else:
                results['failed'].append((lib, message))
                report(RML.Error, message)
    
    # Generate summary
    summary_parts = []
    
    if results['installed']:
        summary_parts.append("Installed: {}".format(", ".join(results['installed'])))
    
    if results['already_installed']:
        libs = [lib for lib, ver in results['already_installed']]
        summary_parts.append("Already installed: {}".format(", ".join(libs)))
    
    if results['failed']:
        libs = [lib for lib, msg in results['failed']]
        summary_parts.append("Failed: {}".format(", ".join(libs)))
    
    summary = " | ".join(summary_parts) if summary_parts else "No changes"
    
    return results, summary


###############################################################################
# INPUT HANDLING
###############################################################################

install = globals().get('install', False)

if not isinstance(install, bool):
    install = False


###############################################################################
# MAIN EXECUTION
###############################################################################

out = ""
installed_libs = []
python_version = ""

# Get Python environment info
python_info = get_python_info()
python_version = "{}.{}.{}".format(
    python_info['version_info'][0],
    python_info['version_info'][1],
    python_info['version_info'][2]
)

# Check if running in compatible environment
if python_info['is_ironpython']:
    out = "ERROR: This component requires CPython (Rhino 8 ScriptEditor).\n"
    out += "Current: IronPython {}\n".format(python_version)
    out += "Cannot install CPython packages in IronPython environment."
    report(RML.Error, out)
else:
    # Edge detection: only run on False->True transition
    if install and not prev_install:
        pip_path = get_pip_path()
        
        if pip_path is None:
            out = "Error: pip.exe not found"
        else:
            report(RML.Remark, "Python version: {}".format(python_version))
            report(RML.Remark, "Using pip at: {}".format(pip_path))
            
            results, summary = install_all_libraries(LIBRARIES, pip_path)
            
            out = "Installation complete: {}".format(summary)
            installed_libs = results['installed'] + [lib for lib, ver in results['already_installed']]
            
            if results['failed']:
                report(RML.Warning, "Some libraries failed to install")
            else:
                report(RML.Remark, "All libraries ready")
    else:
        out = "Python {}: Set 'install' to True to install libraries".format(python_version)
        
        pip_path = get_pip_path()
        if pip_path:
            status_parts = []
            for lib in LIBRARIES:
                is_installed, version = check_library_installed(lib, pip_path)
                if is_installed:
                    status_parts.append("{} ({})".format(lib, version or "?"))
            
            if status_parts:
                out += "\nInstalled: " + ", ".join(status_parts)

# Update persistent state
prev_install = install


###############################################################################
# OUTPUT
###############################################################################

ghenv.Component.Message = "v1.2.0"
# ---------- end install_python_libraries ----------
panel_4 = Panel(install_python_libraries)
